# Grasshopper definition design_container_v2.gh (Grasshopper 1.0.8)
# plug-ins: RhinoCodePluginGH, Swiftlet

# ----
# 1. Get request with weighted parameters
pre_canned_response = Panel("""{
    "received" : true,
    "err" : null,
    "path" : <path_to_obj_file>
}""")
route = Panel("grasshopper")
port = Panel("1917")
ctb = CreateTextBody(
    Content=pre_canned_response,
    IsHtmlChecked=False,
    IsJavascriptChecked=False,
    IsJsonChecked=True,
    IsTextChecked=False,
    IsXmlChecked=False)

L = HTTPListener(Port=port, Route=route, ResponseBody=ctb)  # -> Method, Headers, QueryParams, Content

request_body = Panel(L.Content)
request_method = Panel(L.Method)
parse_json_string = ParseJSONString(Text=request_body)

# ----
# 2. Parse request and extract params
panel = Panel("#_layers")
# בחירת צורת בסיס
panel_2 = Panel("texture_random_range")
get_json_object_key = GetJSONObjectKey(JObject=parse_json_string, Key=panel_2)
get_json_object_key_2 = GetJSONObjectKey(JObject=parse_json_string, Key=panel)
get_json_object_key_3 = GetJSONObjectKey(JObject=parse_json_string, Key="end_domain_spine")
get_json_object_key_4 = GetJSONObjectKey(JObject=parse_json_string, Key="radius")
get_json_object_key_5 = GetJSONObjectKey(JObject=parse_json_string, Key="#_edges")
get_json_object_key_6 = GetJSONObjectKey(JObject=parse_json_string, Key="#_div_points")
get_json_object_key_7 = GetJSONObjectKey(JObject=parse_json_string, Key="layers_power")
get_json_object_key_8 = GetJSONObjectKey(JObject=parse_json_string, Key="random_range")
get_json_object_key_9 = GetJSONObjectKey(JObject=parse_json_string, Key="factor1")
get_json_object_key_10 = GetJSONObjectKey(JObject=parse_json_string, Key="scale_Y1")
get_json_object_key_11 = GetJSONObjectKey(JObject=parse_json_string, Key="factor2")
get_json_object_key_12 = GetJSONObjectKey(JObject=parse_json_string, Key="scale_Y2")
get_json_object_key_13 = GetJSONObjectKey(JObject=parse_json_string, Key="factor3")
get_json_object_key_14 = GetJSONObjectKey(JObject=parse_json_string, Key="scale_Y3")
get_json_object_key_15 = GetJSONObjectKey(JObject=parse_json_string, Key="index_of_circle")
get_json_object_key_16 = GetJSONObjectKey(JObject=parse_json_string, Key="points_div_count")
get_json_object_key_17 = GetJSONObjectKey(JObject=parse_json_string, Key="end_domain_(noisiness)")
get_json_object_key_18 = GetJSONObjectKey(JObject=parse_json_string, Key="wide")
get_json_object_key_19 = GetJSONObjectKey(JObject=parse_json_string, Key="#_of_clusters")
rjv = ReadJSONValue(JValue=get_json_object_key)  # -> AsString, AsNumber, AsBool
rjv_2 = ReadJSONValue(JValue=get_json_object_key_2)  # -> AsString, AsNumber, AsBool
rjv_3 = ReadJSONValue(JValue=get_json_object_key_3)  # -> AsString, AsNumber, AsBool
rjv_4 = ReadJSONValue(JValue=get_json_object_key_4)  # -> AsString, AsNumber, AsBool
rjv_5 = ReadJSONValue(JValue=get_json_object_key_5)  # -> AsString, AsNumber, AsBool
rjv_6 = ReadJSONValue(JValue=get_json_object_key_6)  # -> AsString, AsNumber, AsBool
rjv_7 = ReadJSONValue(JValue=get_json_object_key_7)  # -> AsString, AsNumber, AsBool
rjv_8 = ReadJSONValue(JValue=get_json_object_key_8)  # -> AsString, AsNumber, AsBool
rjv_9 = ReadJSONValue(JValue=get_json_object_key_9)  # -> AsString, AsNumber, AsBool
rjv_10 = ReadJSONValue(JValue=get_json_object_key_10)  # -> AsString, AsNumber, AsBool
rjv_11 = ReadJSONValue(JValue=get_json_object_key_11)  # -> AsString, AsNumber, AsBool
rjv_12 = ReadJSONValue(JValue=get_json_object_key_12)  # -> AsString, AsNumber, AsBool
rjv_13 = ReadJSONValue(JValue=get_json_object_key_13)  # -> AsString, AsNumber, AsBool
rjv_14 = ReadJSONValue(JValue=get_json_object_key_14)  # -> AsString, AsNumber, AsBool
rjv_15 = ReadJSONValue(JValue=get_json_object_key_15)  # -> AsString, AsNumber, AsBool
rjv_16 = ReadJSONValue(JValue=get_json_object_key_16)  # -> AsString, AsNumber, AsBool
rjv_17 = ReadJSONValue(JValue=get_json_object_key_17)  # -> AsString, AsNumber, AsBool
rjv_18 = ReadJSONValue(JValue=get_json_object_key_18)  # -> AsString, AsNumber, AsBool
rjv_19 = ReadJSONValue(JValue=get_json_object_key_19)  # -> AsString, AsNumber, AsBool
panel_3 = Panel(rjv_2.AsNumber)
panel_4 = Panel(rjv_3.AsNumber)
panel_5 = Panel(rjv_5.AsNumber)
panel_6 = Panel(rjv_6.AsNumber)
panel_7 = Panel(rjv_7.AsNumber)
panel_8 = Panel(rjv_8.AsNumber)
panel_9 = Panel(rjv_9.AsNumber)
panel_10 = Panel(rjv_10.AsNumber)
panel_11 = Panel(rjv_11.AsNumber)
panel_12 = Panel(rjv_12.AsNumber)
panel_13 = Panel(rjv_13.AsNumber)
panel_14 = Panel(rjv_14.AsNumber)
panel_15 = Panel(rjv_15.AsNumber)
panel_16 = Panel(rjv_16.AsNumber)
panel_17 = Panel(rjv_17.AsNumber)
panel_18 = Panel(rjv_18.AsNumber)
panel_19 = Panel(rjv_4.AsNumber)
panel_20 = Panel(rjv_19.AsNumber)
panel_21 = Panel(rjv.AsNumber)

# ----
# בחירת צורת בסיס
# 3. Generate object
# קו מתאר
# יצירת מש
# בחירת קו מתאר אופקי
# בניית מש לאחר הזזת נקודות
# קלסטרים לנקודות
# טקסטורה
# חיתוך ישר של התחתית
# בחירה של הגוף המרכזי
# יצירת תחתית
cluster = Cluster(
    layers=panel_3,
    layers_power=panel_7,
    domain_end=panel_4,
    div_points=panel_6,
    edges=panel_5,
    random_range=panel_8,
    radius=panel_19)
cluster_2 = Cluster_2(
    factor=panel_9,
    scale_y=panel_10,
    factor_2=panel_11,
    layers=panel_3,
    interpolate_curve=cluster,
    scale_y_2=panel_12,
    factor_3=panel_13,
    scale_y_3=panel_14)
cluster_3 = Cluster_3(value=panel_15, radius=panel_19, points_div_count=panel_16, layers=panel_3, end_domain_noisiness=panel_17)
cluster_4 = Cluster_4(curves=cluster_2)
cluster_5 = Cluster_5(mesh=cluster_4, curve=cluster_3, value=panel_18, domain_end=panel_18)
cluster_6 = Cluster_7(of_clusters=panel_20, mesh=cluster_5)  # -> all_vertices, points_to_move, positive, normals_of_points_to_move, faces
cluster_7 = Cluster_6(
    priv_step_mesh_faces=cluster_6.faces,
    relay=cluster_6.all_vertices,
    vertices_to_manipulate=cluster_6.points_to_move,
    normals=cluster_6.normals_of_points_to_move,
    random_range=panel_21,
    indices=cluster_6.positive)
cluster_8 = Cluster_8(mesh=cluster_7)
cluster_9 = Cluster_9(mesh=cluster_8)
cluster_10 = Cluster_10(top_mesh=cluster_9)  # -> bottom_mesh, offset_top_mesh

geometries = Relay([cluster_9, cluster_10.bottom_mesh])

# ----
# 4. Export obj file
colour_swatch = ColourSwatch(SwatchColor=RGB(255, 255, 255))
offset_geometries = Relay([cluster_10.bottom_mesh, cluster_10.offset_top_mesh])
geometries_2 = Relay([cluster_10.bottom_mesh, cluster_9])
file_path = FilePath("C:\Users\rosen\Desktop\pagmar2024\test_objs\")
custom_preview = CustomPreview(Geometry=geometries_2, Material=ColourSwatch(SwatchColor=RGB(255, 255, 255)))
custom_preview_2 = CustomPreview(Geometry=offset_geometries, Material=colour_swatch)
# סגירת תחתית
# לתקן פה איזה רשימה לקחת
c_script = CSharpScript(geometries=geometries, filename="sample2.obj", directory=file_path, export=Toggle(False))  # -> out, a; inputs geometries: tree of GeometryBase, filename: String, directory: String, export: Boolean
# ---------- c_script: C# ----------
// Grasshopper Script Instance
#region Usings
using System;
using System.Linq;
using System.Collections;
using System.Collections.Generic;
using System.Drawing;
using System.IO;

using Rhino;
using Rhino.Geometry;

using Grasshopper;
using Grasshopper.Kernel;
using Grasshopper.Kernel.Data;
using Grasshopper.Kernel.Types;
#endregion

public class Script_Instance : GH_ScriptInstance
{
    #region Notes
    /* 
      Members:
        RhinoDoc RhinoDocument
        GH_Document GrasshopperDocument
        IGH_Component Component
        int Iteration

      Methods (Virtual & overridable):
        Print(string text)
        Print(string format, params object[] args)
        Reflect(object obj)
        Reflect(object obj, string method_name)
    */
    #endregion

    private void RunScript(
	DataTree<GeometryBase> geometries,
	string filename,
	string directory,
	bool export,
	ref object a)
    {
        if(export){
            List<Guid> guids = new List<Guid>();
            for(int i = 0; i < geometries.BranchCount; i++){
                for(int n = 0; n < geometries.Branches[i].Count; n++){
                    var geom = geometries.Branches[i][n];
                    var guid = Rhino.RhinoDoc.ActiveDoc.Objects.Add(geom);
                    guids.Add(guid);
                }
            }

            Rhino.RhinoDoc.ActiveDoc.Objects.Select(guids);

            string filepath = Path.Combine(directory, filename);
            string cmd = "_-Export " + "\"" + filepath + "\"" + " _Enter";
            Rhino.RhinoApp.RunScript(cmd, false);

            Rhino.RhinoDoc.ActiveDoc.Objects.Delete(guids, true);
        }
    }
}
# ---------- end c_script ----------

# ==== cluster Cluster
div_points = ClusterInput()
layers = ClusterInput()
domain_end = ClusterInput()
space_between_items = Slider(0.315, range=0..1)
radius = ClusterInput()
edges = ClusterInput()
layers_power = ClusterInput()
random_range = ClusterInput()

# ----
# בחירת צורת בסיס
# כמות השכבות שיעברו מניפולציה
# בחירת השכבות
number_slider = Slider(0, range=0..100)
construct_domain = ConstructDomain(DomainStart=number_slider, DomainEnd=domain_end)
range = Range(Domain=construct_domain, Steps=layers)
graph_mapper = GraphMapper(
    range,
    x0=0,
    x1=1,
    y0=0,
    y1=1,
    amplitude=0.3352829218,
    container_name="Perlin",
    decay=0.3902163506,
    frequency=0.0409604013,
    x_offset=0.2560233176,
    y_offset=0.4702891707)
bounds = Bounds(Numbers=graph_mapper)
series = Series(Start=0, Step=space_between_items, Count=layers)
remap_numbers = RemapNumbers(Value=graph_mapper, Source=bounds, Target=Domain(0, 1))  # -> Mapped, Clipped
construct_point = ConstructPoint(XCoordinate=remap_numbers.Mapped, YCoordinate=range, ZCoordinate=series)
circle_cnr = CircleCNR(Center=construct_point, Normal=Vector(0, 0, 1), Radius=radius)
end = Slider(100, range=0..100)
start = Slider(0, range=0..100)
divide_curve = DivideCurve(Curve=circle_cnr, Count=edges, Kinks=False)  # -> Points, Tangents, Parameters
construct_domain_2 = ConstructDomain(DomainStart=start, DomainEnd=expr("x-1", layers))
construct_domain_3 = ConstructDomain(DomainStart=start, DomainEnd=end)
polyline = PolyLine(Vertices=divide_curve.Points, Closed=Toggle(True))
remap_numbers_2 = RemapNumbers(Value=layers_power, Source=construct_domain_3, Target=construct_domain_2)  # -> Mapped, Clipped
round = Round(Number=remap_numbers_2.Mapped)  # -> Nearest, Floor, Ceiling
divide_curve_2 = DivideCurve(Curve=polyline, Count=div_points, Kinks=False)  # -> Points, Tangents, Parameters
tree_statistics = TreeStatistics(Tree=divide_curve_2.Tangents)  # -> flatten(Paths), Length, Count
list_item = ListItem(List=tree_statistics.Paths, Index="0", Wrap=True)
python_3_script = Python3Script(total=layers, x=round.Floor, path_format=list_item)  # -> a
# ---------- python_3_script: Python ----------
import random

# Inputs
# total: upper bound for the random number (exclusive)
# x: number of paths to generate
# path_format: the format of the path (e.g., '{0;0;0;0}' or '{0;0;0;0;0}')
chosen_numbers = []
paths = ""

# Convert path_format to string if it's a GH_Path object
if hasattr(path_format, 'ToString'):
    path_format = path_format.ToString()

# Convert total to a float and then to an integer if it's a string
total = int(float(total))

# Determine the number of parts in the path_format
path_parts = path_format.strip('{}').split(';')

# Generate a list of paths
for i in range(x):
    random_number = random.randint(0, total - 1)
    while random_number in chosen_numbers:
        random_number = random.randint(0, total - 1)
    chosen_numbers.append(random_number)
    
    # Insert the random number into the correct position
    path_parts[-2] = str(random_number)
    
    # Create the formatted path string
    formatted_path = "{" + ";".join(path_parts) + "}"
    
    if i == (x - 1):
        paths = paths + formatted_path
    else:
        paths = paths + formatted_path + "\n"

# Output
print(paths)
a = paths
# ---------- end python_3_script ----------
panel = Panel(divide_curve_2.Points)
panel_2 = Panel(python_3_script)
tree_branch = TreeBranch(Tree=divide_curve_2.Tangents, Path=python_3_script, MaintainPaths=True)
split_tree = SplitTree(Data=divide_curve_2.Points, Masks=flatten(python_3_script))  # -> Positive, Negative
series_2 = Series(Start=0, Step=1, Count=round.Floor)
unit_z = UnitZ(Factor=1)
random = Random(Range=random_range, Number=div_points, Seed=series_2)
rotate = Rotate(Vector=tree_branch, Axis=unit_z, Angle=degrees("-90"))
amplitude = Amplitude(Vector=rotate, Amplitude=random)
move = Move(Geometry=split_tree.Positive, Motion=amplitude)  # -> Geometry, Transform
interpolate = Interpolate(Vertices=[split_tree.Negative, move.Geometry], Degree=3, Periodic=Toggle(True), KnotStyle=1)  # -> flatten(Curve), Length, Domain

curve = ClusterOutput(interpolate.Curve)

# ==== cluster Cluster_2
layers = ClusterInput()
interpolate_curve = ClusterInput()
factor = ClusterInput()
factor_2 = ClusterInput()
factor_3 = ClusterInput()
scale_y = ClusterInput()
scale_y_2 = ClusterInput()
scale_y_3 = ClusterInput()

# ----
# קו מתאר
pi = Pi(Factor=factor)
pi_2 = Pi(Factor=factor_2)
pi_3 = Pi(Factor=factor_3)
range = Range(Domain=pi, Steps=layers)
range_2 = Range(Domain=pi_2, Steps=layers)
range_3 = Range(Domain=pi_3, Steps=layers)
sine = Sine(Value=range)
sine_2 = Sine(Value=range_2)
sine_3 = Sine(Value=range_3)
construct_point = ConstructPoint(XCoordinate=range, YCoordinate=sine, ZCoordinate=sine)
construct_point_2 = ConstructPoint(XCoordinate=range_2, YCoordinate=sine_2, ZCoordinate=sine_2)
construct_point_3 = ConstructPoint(XCoordinate=range_3, YCoordinate=sine_3, ZCoordinate=sine_3)
scale_nu = ScaleNU(Geometry=construct_point, Plane=PlaneXY(0, 0, 0), ScaleX=1, ScaleY=scale_y, ScaleZ=1)  # -> Geometry, Transform
scale_nu_2 = ScaleNU(Geometry=construct_point_2, Plane=PlaneXY(0, 0, 0), ScaleX=1, ScaleY=scale_y_2, ScaleZ=1)  # -> Geometry, Transform
scale_nu_3 = ScaleNU(Geometry=construct_point_3, Plane=PlaneXY(0, 0, 0), ScaleX=1, ScaleY=scale_y_3, ScaleZ=1)  # -> Geometry, Transform
addition = Addition(A=scale_nu.Geometry, B=scale_nu_2.Geometry, C=scale_nu_3.Geometry)
nurbs_curve = NurbsCurve(Vertices=addition, Degree=3, Periodic=False)  # -> Curve, Length, Domain
bounding_rectangle = BoundingRectangle(Geometry=nurbs_curve.Curve, Plane=PlaneXY(0, 0, 0), Axis=0, Slide=0, Union=True)  # -> Bounding, DimensionX, DimensionY
range_4 = Range(Domain=Domain(0, 1), Steps=expr("x-1", layers))
curve_graph_mapper = CurveGraphMapper(
    Curves=nurbs_curve.Curve,
    Rectangle=bounding_rectangle.Bounding,
    Values=range_4,
    YAxis="0 to 4",
    Flip=False,
    Snap=False,
    TextSize=1)  # -> Mapped, GraphCurves, GraphPoints, ValueLines, ValuePoints, MappedLines, MappedPoints, Boundary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
quick_graph = QuickGraph(curve_graph_mapper.Mapped, SortOrder=0)
bounds = Bounds(Numbers=curve_graph_mapper.Mapped)
remap_numbers = RemapNumbers(Value=curve_graph_mapper.Mapped, Source=bounds, Target="1 to 2")  # -> Mapped, Clipped
area = Area(Geometry=interpolate_curve)  # -> Area, Centroid
scale = Scale(Geometry=interpolate_curve, Center=area.Centroid, Factor=remap_numbers.Mapped)  # -> Geometry, Transform

geometry = ClusterOutput(scale.Geometry)

# ==== cluster Cluster_3
layers = ClusterInput()
radius = ClusterInput()
value = ClusterInput()
points_div_count = ClusterInput()
end_domain_noisiness = ClusterInput()

# ----
# בחירת קו מתאר אופקי
space_between_items = Slider(0.315, range=0..1)
xy_cords = Slider(0, range=0..100)
series = Series(Start=0, Step=space_between_items, Count=layers)
construct_point = ConstructPoint(XCoordinate=xy_cords, YCoordinate=xy_cords, ZCoordinate=series)
construct_domain = ConstructDomain(DomainStart=0, DomainEnd=expr("x-1", layers))
source_domain = Panel("0 to 50")
circle_cnr = CircleCNR(Center=construct_point, Normal=Vector(0, 0, 1), Radius=radius)
remap_numbers = RemapNumbers(Value=value, Source=source_domain, Target=construct_domain)  # -> Mapped, Clipped
round = Round(Number=remap_numbers.Mapped)  # -> Nearest, Floor, Ceiling
list_item = ListItem(List=circle_cnr, Index=round.Nearest, Wrap=True)
divide_curve = DivideCurve(Curve=list_item, Count=points_div_count, Kinks=False)  # -> Points, Tangents, Parameters
graph_mapper = GraphMapper(
    divide_curve.Points,
    x0=0,
    x1=1,
    y0=0,
    y1=1,
    amplitude=0.4027948976,
    container_name="Perlin",
    decay=0.3865772486,
    frequency=0.06612318754,
    x_offset=0.5,
    y_offset=0.5)
unit_z = UnitZ(Factor=1)
construct_domain_2 = ConstructDomain(DomainStart=0, DomainEnd=end_domain_noisiness)
bounds = Bounds(Numbers=graph_mapper)
rotate = Rotate(Vector=divide_curve.Tangents, Axis=unit_z, Angle=degrees("-90"))
remap_numbers_2 = RemapNumbers(Value=graph_mapper, Source=bounds, Target=construct_domain_2)  # -> Mapped, Clipped
amplitude = Amplitude(Vector=rotate, Amplitude=remap_numbers_2.Mapped)
move = Move(Geometry=divide_curve.Points, Motion=amplitude)  # -> Geometry, Transform
interpolate = Interpolate(Vertices=move.Geometry, Degree=3, Periodic=Toggle(True), KnotStyle=1)  # -> Curve, Length, Domain

curve = ClusterOutput(interpolate.Curve)

# ==== cluster Cluster_4
curves = ClusterInput()

# ----
# יצירת מש
loft = Loft(Curves=curves, Options={Adjust=False, Closed=False, LoftEnds=0, LoftSimp=0, LoftType=0, Rebuild=10, Refit=0.01})
flip = Flip(Surface=loft)  # -> Surface, Result
number_slider = Slider(109, range=0..200)
mesh_surface = MeshSurface(Surface=flip.Surface, UCount=number_slider, VCount=number_slider, Overhang=True, Equalize=False)
align_vertices = AlignVertices(Mesh=mesh_surface, Tolerance=0.01)  # -> Result, Count
weaverbird_s_join_meshes_and_weld = WeaverbirdsJoinMeshesAndWeld(Mesh=align_vertices.Result, Weld=Toggle(True))

mesh = ClusterOutput(weaverbird_s_join_meshes_and_weld)

# ==== cluster Cluster_5
mesh = ClusterInput()
curve = ClusterInput()
value = ClusterInput()
negative = Negative(Value=value)
domain_end = ClusterInput()

# ----
# בניית מש לאחר הזזת נקודות
deconstruct_mesh = DeconstructMesh(Mesh=mesh)  # -> flatten(Vertices), Faces, Colours, Normals
curve_closest_point = CurveClosestPoint(Point=deconstruct_mesh.Vertices, Curve=curve)  # -> Point, Parameter, Distance
negative_2 = Negative(Value=curve_closest_point.Distance)
average = Average(Input=curve_closest_point.Point)
construct_domain = ConstructDomain(DomainStart=0, DomainEnd=domain_end)
bounds = Bounds(Numbers=negative_2)
remap_numbers = RemapNumbers(Value=negative_2, Source=bounds, Target=construct_domain)  # -> Mapped, Clipped
vector_2pt = Vector2Pt(PointA=average, PointB=curve_closest_point.Point, Unitize=False)  # -> Vector, Length
multiplication = Multiplication(A=vector_2pt.Length, B=remap_numbers.Mapped)
amplitude = Amplitude(Vector=vector_2pt.Vector, Amplitude=multiplication)
move = Move(Geometry=deconstruct_mesh.Vertices, Motion=amplitude)  # -> Geometry, Transform
construct_mesh = ConstructMesh(Vertices=move.Geometry, Faces=deconstruct_mesh.Faces)

mesh_2 = ClusterOutput(construct_mesh)

# ==== cluster Cluster_6
random_range = ClusterInput()
indices = ClusterInput()
normals = ClusterInput()
vertices_to_manipulate = ClusterInput()
relay = ClusterInput()
priv_step_mesh_faces = ClusterInput()

# ----
# טקסטורה
negative = Negative(Value=random_range)
list_length = ListLength(List=indices)
random = Random(Range=negative, Number=list_length, Seed=2)
amplitude = Amplitude(Vector=normals, Amplitude=random)
move = Move(Geometry=vertices_to_manipulate, Motion=amplitude)  # -> Geometry, Transform
replace_items = ReplaceItems(List=relay, Item=move.Geometry, Indices=indices, Wrap=False)
smooth_strength = Slider(0.15, range=0..1)
construct_mesh = ConstructMesh(Vertices=replace_items, Faces=priv_step_mesh_faces)
scale_factor = Slider(3, range=0..10)
smooth_mesh = SmoothMesh(Mesh=construct_mesh, Strength=smooth_strength, SkipNaked=True, Iterations=1)
scale = Scale(Geometry=smooth_mesh, Center=Point(0, 0, 0), Factor=scale_factor)  # -> Geometry, Transform

geometry = ClusterOutput(scale.Geometry)

# ==== cluster Cluster_7
mesh = ClusterInput()
of_clusters = ClusterInput()

# ----
# קלסטרים לנקודות
deconstruct_mesh = DeconstructMesh(Mesh=mesh)  # -> flatten(Vertices), Faces, Colours, Normals
panel = Panel(deconstruct_mesh.Normals)
panel_2 = Panel(deconstruct_mesh.Vertices)
entwine = Entwine(Branch00=deconstruct_mesh.Vertices, Branch01=deconstruct_mesh.Normals, FlattenInputs=True)
flip_matrix = FlipMatrix(Data=entwine)
k_means_clustering = KMeansClustering(TrainingInputs=flip_matrix, OfClusters=of_clusters, RandomSeed=5)  # -> Result, Likelihood, Centroids
panel_3 = Panel(k_means_clustering.Result)
cset = CreateSet(List=k_means_clustering.Result)  # -> Set, Map
panel_4 = Panel(cset.Set)
mindex = MemberIndex(Set=k_means_clustering.Result, Member=cset.Set)  # -> Index, Count
panel_5 = Panel(mindex.Index)
sort = SortList(Keys=mindex.Count)  # -> reverse(Keys), ValuesA
item = ListItem(List=sort.Keys, Index=0, Wrap=True)
int = Integer(item)
mindex_2 = MemberIndex(Set=mindex.Count, Member=int)  # -> Index, Count
item_2 = ListItem(List=cset.Set, Index=mindex_2.Index, Wrap=True)
most_common_numbers_in_the_list = Panel(item_2)
max_num_of_appearance = Panel(int)
item_index = ItemIndex(List=cset.Set, Item=item_2)
concatenate = Concatenate(prefix="{0;0;0;", index=item_index, suffix="}")
split_tree = SplitTree(Data=mindex.Index, Masks=flatten(concatenate))  # -> Positive, flatten(Negative)
list_item = ListItem(List=deconstruct_mesh.Vertices, Index=split_tree.Positive, Wrap=True)
item_3 = ListItem(List=deconstruct_mesh.Normals, Index=split_tree.Positive, Wrap=True)

faces = ClusterOutput(deconstruct_mesh.Faces)
all_vertices = ClusterOutput(deconstruct_mesh.Vertices)
positive = ClusterOutput(split_tree.Positive)
points_to_move = ClusterOutput(list_item)
normals_of_points_to_move = ClusterOutput(item_3)

# ==== cluster Cluster_8
mesh = ClusterInput()
number_slider = Slider(100, range=0..100)
plane_surface = PlaneSurface(Plane=PlaneXY(0, 0, 0), XSize=number_slider, YSize=number_slider)
move = Move(Geometry=plane_surface, Motion="{-50, -50, 0.5}")  # -> Geometry, Transform
mesh_split = MeshSplit(Mesh=mesh, Splitters=move.Geometry)
list_item = ListItem(List=mesh_split, Index="0", Wrap=True)
list_item_2 = ListItem(List=mesh_split, Index="1", Wrap=True)
area = Area(Geometry=list_item)  # -> Area, Centroid
area_2 = Area(Geometry=list_item_2)  # -> Area, Centroid
panel = Panel(mesh_split)
expression = Expression(x=area.Area, y=area_2.Area, Expression="if(x<y, 0, 1)")
cull_index = CullIndex(List=mesh_split, Indices=expression, Wrap=True)
bounding_box = BoundingBox(Content=cull_index, Plane=PlaneXY(0, 0, 0))  # -> Box, Box_2
# חיתוך ישר של התחתית
mesh_2 = Mesh(cull_index)
deconstruct_box = DeconstructBox(Box=bounding_box.Box)  # -> Plane, X, Y, Z
panel_2 = Panel(deconstruct_box.Z)
deconstruct_domain = DeconstructDomain(Domain=deconstruct_box.Z)  # -> Start, End
negative = Negative(Value=deconstruct_domain.Start)
vector_xyz = VectorXYZ(XComponent="0", YComponent="0", ZComponent=negative)  # -> Vector, Length
move_2 = Move(Geometry=mesh_2, Motion=vector_xyz.Vector)  # -> Geometry, Transform
geometry = ClusterOutput(move_2.Geometry)

# ==== cluster Cluster_9
mesh = ClusterInput()
# בחירה של הגוף המרכזי
weaverbird_s_catmull_clark_subdivision = WeaverbirdsCatmullClarkSubdivision(MeshCurves=mesh, Level=Slider(2, range=0..10), SmoothNakedEdges=1)  # -> flatten(OutputMeshCurves)
area = Area(Geometry=weaverbird_s_catmull_clark_subdivision)  # -> Area, Centroid
bounds = Bounds(Numbers=area.Area)
deconstruct_domain = DeconstructDomain(Domain=bounds)  # -> Start, End
member_index = MemberIndex(Set=area.Area, Member=deconstruct_domain.End)  # -> Index, Count
list_item = ListItem(List=weaverbird_s_catmull_clark_subdivision, Index=member_index.Index, Wrap=True)
mesh_2 = Mesh(list_item)
mesh_3 = ClusterOutput(mesh_2)

# ==== cluster Cluster_10
top_mesh = ClusterInput()
domain_start = Slider(0, range=0..100)
domain_end = Slider(0.0001, range=0..0.0001)
deconstruct_mesh = DeconstructMesh(Mesh=top_mesh)  # -> flatten(Vertices), Faces, Colours, Normals
deconstruct = Deconstruct(Point=deconstruct_mesh.Vertices)  # -> XComponent, YComponent, ZComponent
construct_domain = ConstructDomain(DomainStart=domain_start, DomainEnd=domain_end)
includes = Includes(Value=deconstruct.ZComponent, Domain=construct_domain)  # -> Includes, Deviation
# יצירת תחתית
dispatch = Dispatch(List=deconstruct_mesh.Vertices, DispatchPattern=includes.Includes)  # -> ListA, ListB
circle = Circle(Plane=PlaneXY(0, 0, 0), Radius=Slider(27, range=0..50))
divide_curve = DivideCurve(Curve=circle, Count=Slider(50, range=0..100), Kinks=False)  # -> Points, Tangents, Parameters
uv_count = Slider(109, range=0..1000)
closest_points = ClosestPoints(Point=divide_curve.Points, Cloud=dispatch.ListA, Count=Slider(1, range=0..1))  # -> flatten(ClosestPoint), CPIndex, Distance
interpolate = Interpolate(Vertices=closest_points.ClosestPoint, Degree=3, Periodic=Toggle(True), KnotStyle=1)  # -> Curve, Length, Domain
panel = Panel(interpolate.Curve)
boundary_surfaces = BoundarySurfaces(Edges=interpolate.Curve)
mesh_surface = MeshSurface(Surface=boundary_surfaces, UCount=uv_count, VCount=uv_count, Overhang=True, Equalize=False)
mesh_offset = MeshOffset(Mesh=top_mesh, OffsetDistance=Slider(3, range=0..3), SolidToggle=Toggle(True), OffsetBothSidesToggle=False)
custom_preview = CustomPreview(Geometry=[mesh_surface, top_mesh], Material=ColourSwatch(SwatchColor=RGB(223, 223, 235)))
bottom_mesh = ClusterOutput(mesh_surface)
offset_top_mesh = ClusterOutput(mesh_offset)
